vi "index.gviweb"   [LabVIEW NXG 5.0.0]
panel indicators:
  "Boolean Constant": bool
  "Chart": i32
diagram:
  # Place setup code before the loop. For example, perform initial data communication and wire the results into the loop.
  # Top-Level WebVIs usually contain a While Loop that never stops so that they can continue running as long as the web page is open in the user's web browser.
  s1 = FALSE  # shift register
  while (iteration -> i1) {
    Quotient And Remainder(x=i1, y=20) -> (x-y*floor(x/y)=w1)
    Is Equal To 0(x=w1) -> w2
    Not(x=s1) -> w3
    Select(s=w2, t=w3, f=s1) -> w4
    $"Boolean Constant" <- w4
    $Chart <- w1
    Wait(time to wait=50)
    next s1 = w4
    stop if FALSE
  }
